# Grasshopper definition Terrain & Walls & Roofs.gh (Grasshopper 1.0.7)
# plug-ins: Kangaroo2 Components, Pufferfish, Human, Weaverbird, Speckle 2, MetaHopper, ShapeDiverForGrasshopper, Rhino.Inside for Autodesk Revit

# ----
# TURN OFF
# BEFORE
# OPENING
# RHINO
# FILE
# UNITS & FLOORS (Sorted by Levels)
toggle = GroupToggle(ToggleActive=True, ToggleVisible=False)  # disabled

# ---- group: New Site Mesh (A4)
mesh = Mesh(<mesh referenced from the Rhino model>)

# ---- group: Projection Plane Point
pt = Point(<point referenced from the Rhino model>)

# ---- group: UNITS (LATEST LOCATION)
brep = Brep([<brep referenced from the Rhino model> x74])

# ---- group: Units Internalised LATEST LOCATION
brep_2 = Brep([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])

# ----
volume = Volume(Geometry=brep)  # -> Volume, Centroid
# 03
# 02
# 01
# 00
pdecon = Deconstruct(Point=volume.Centroid)  # -> XComponent, YComponent, ZComponent
cset = CreateSet(List=pdecon.ZComponent)  # -> Set, Map
sort = SortList(Keys=cset.Set)  # -> Keys, ValuesA
mindex = MemberIndex(Set=pdecon.ZComponent, Member=graft(sort.Keys))  # -> Index, Count

# ---- group: Units Grouped by Level
item = ListItem(List=brep, Index=mindex.Index, Wrap=True)

# ----
# Contour Lines (Projected on plane above)
xy = XYPlane(Origin=pt)
project = Project(Geometry=flatten(item), Plane=xy)  # -> Geometry, Transform
debrep = DeconstructBrep(Brep=project.Geometry)  # -> Faces, flatten(Edges), Vertices
len = Length(Curve=debrep.Edges)
larger = LargerThan(FirstNumber=len, SecondNumber="0.001")  # -> LargerThan, OrEqualTo
cull = CullPattern(List=debrep.Edges, CullPattern=larger.LargerThan)
panel = Panel("""0
1""")
cull_2 = CullPattern(List=cull, CullPattern=panel)
join = JoinCurves(Curves=cull_2, Preserve=False)
runion = RegionUnion(Curves=flatten(join))
item_2 = ListItem(List=runion, Index=0, Wrap=True)  # -> Item, Item1
number_slider = Slider(0.49, range=0..20)
disc = Discontinuity(Curve=item_2.Item, Level=1)  # -> Points, Parameters
nurbs = NurbsCurve(Vertices=disc.Points, Degree=3, Periodic=True)  # -> Curve, Length, Domain
neg = Negative(Value=number_slider)
xy_2 = XYPlane(Origin=Point(0, 0, 0))
offset = OffsetCurve(Curve=nurbs.Curve, Distance=number_slider, Corners=3)
offset_2 = OffsetCurve(Curve=offset, Distance=neg, Plane=xy_2, Corners=1)
offset_3 = OffsetCurve(Curve=offset_2, Distance=neg, Plane=xy_2, Corners=1)
series = Series(Start=Slider(0.06, range=-2..5), Step=Slider(2.03, range=-2..5), Count=Slider(7, range=0..10))
offset_4 = OffsetCurve(Curve=nurbs.Curve, Distance=series, Corners=1)  # -> flatten(Curve)

debrep_2 = DeconstructBrep(Brep=item)  # -> Faces, Edges, Vertices
bang = ExplodeTree(Data=item)  # -> Branch0, Branch1, Branch2, Branch3
area = Area(Geometry=debrep_2.Faces)  # -> Area, Centroid
pdecon_2 = Deconstruct(Point=area.Centroid)  # -> XComponent, YComponent, ZComponent
brep_3 = Brep(bang.Branch3)
brep_4 = Brep(item)
panel_2 = Panel()
panel_3 = Panel()
panel_4 = Panel("https://macad.speckle.xyz/streams/4975f9f0a8/commits/8fbb543497")
sort_2 = SortList(Keys=pdecon_2.ZComponent, ValuesA=debrep_2.Faces)  # -> Keys, ValuesA
brep_5 = Brep([<brep referenced from the Rhino model> x71])
item_3 = ListItem(List=sort_2.ValuesA, Index=0, Wrap=True)  # -> Item1, Item
esokv = ExtendSpeckleObjectByKeyValue(Keys=panel_3, Values=panel_2, selectedKitName="Objects")

# ---- group: Floors Grouped by Levels
trim = TrimTree(Tree=item_3.Item, Depth=1)

# ----
receive = Receive(
    Stream=panel_4,
    AutoReceive=False,
    CurrentComponentState="expired",
    ExpandOutput=True,
    ReceiveOnOpen=False,
    ReceivedCommitId="8fbb543497",
    StreamWrapper="https://macad.speckle.xyz/streams/4975f9f0a8/commits/8fbb543497",
    selectedKitName="Objects")  # -> Info, CONTOURS, SOIL; disabled
panel_5 = Panel("https://macad.speckle.xyz/streams/4975f9f0a8/branches/site%2F04-community-site")
area_2 = Area(Geometry=trim)  # -> Area, Centroid
Z = UnitZ(Factor="-1")

# ---- group: Community Site Stream (Last Commit at the time)
panel_6 = Panel("https://macad.speckle.xyz/streams/4975f9f0a8/commits/8fbb543497")

# ----
move = Move(Geometry=area_2.Centroid, Motion=Z)  # -> Geometry, Transform
project_2 = ProjectPoint(Point=move.Geometry, Direction=Vector(0, 0, -1), Geometry=flatten(trim))  # -> Point, Index
bbox = BoundingBox(Content=brep_5, Plane=PlaneXY(0, 0, 0), UnionBox=True)  # -> Box, Box_2
null = NullItem(Item=project_2.Point)  # -> NullFlags, InvalidFlags, Description
volume_2 = Volume(Geometry=bbox.Box_2)  # -> Volume, Centroid

# ---- group: Floors by Levels (no duplication)
cull_3 = CullPattern(List=trim, CullPattern=null.NullFlags)

# ----
receive_2 = Receive(
    Stream=panel_6,
    AutoReceive=False,
    CurrentComponentState="expired",
    ExpandOutput=True,
    ReceiveOnOpen=False,
    ReceivedCommitId="8fbb543497",
    StreamWrapper="https://macad.speckle.xyz/streams/4975f9f0a8/commits/8fbb543497",
    selectedKitName="Objects")  # -> Info, CONTOURS, SOIL; disabled
send = Send(
    Stream=panel_5,
    Message="First one here :)",
    Brep=brep_5,
    AutoSend=False,
    BaseId="4211a9499277c30a864f8af716dcf53c",
    CurrentComponentState="expired",
    KitName="Objects",
    OutputWrappers="https://macad.speckle.xyz\t4975f9f0a8\t25e44ca5db",
    UseDefaultCache=True,
    selectedKitName="Objects")  # disabled
sph = Sphere(Base=volume_2.Centroid, Radius=Slider(100, range=0..1000))
join_2 = BrepJoin(Breps=cull_3)  # -> Breps, Closed

crv = Curve(item_2.Item1)
disc_2 = Discontinuity(Curve=crv, Level=1)  # -> Points, Parameters
nurbs_2 = NurbsCurve(Vertices=disc_2.Points, Degree=3, Periodic=True)  # -> Curve, Length, Domain

panel_7 = Panel("""ELEMENTAL MARS
G06
VOLUME
MULTIPLE
SITE-PLACE HOLDER
NO MATERIAL""")
panel_8 = Panel("""BIMSC-PROJECT
BIMSC-ORIGINATOR
BIMSC-VOLUME
BIMSC-LEVEL
BIMSC-TYPE
BIMSC-MATERIAL""")
edges = BrepEdges(Brep=join_2.Breps)  # -> Naked, Interior, NonManifold
pt_2 = Point([<point referenced from the Rhino model> x4])

# ---- group: Materials Stream
panel_9 = Panel("https://macad.speckle.xyz/streams/4975f9f0a8/commits/d13e3ec6c6")

# ----
dso = DeconstructSpeckleObject(SpeckleObject=receive_2.SOIL, selectedKitName="Objects")
geo = Geometry(edges.Naked)

# ---- group: G06 Stream
panel_10 = Panel("https://macad.speckle.xyz/streams/4975f9f0a8/branches/students%2Fg06-site_locations")

# ----
boundary = BoundarySurfaces(Edges=geo)
mesh_2 = Mesh(dso)
receive_3 = Receive(
    Stream=panel_9,
    AutoReceive=False,
    CurrentComponentState="expired",
    ExpandOutput=True,
    ReceiveOnOpen=False,
    ReceivedCommitId="d13e3ec6c6",
    StreamWrapper="https://macad.speckle.xyz/streams/4975f9f0a8/commits/d13e3ec6c6",
    selectedKitName="Objects")  # -> Info, Materials; disabled
rev = ReverseList(List=pt_2)
esokv_2 = ExtendSpeckleObjectByKeyValue(SpeckleObject=brep_4, Keys=panel_8, Values=panel_7, selectedKitName="Objects")
sovk = SpeckleObjectValueByKey(Object=receive_2.SOIL, Key="A4", selectedKitName="Objects")
area_3 = Area(Geometry=boundary)  # -> Area, Centroid
cps = ClosestPoints(Point=pt_2, Cloud=disc_2.Points, Count="24")  # -> ClosestPoint, CPIndex, Distance
cir = Circle(Plane=pt_2, Radius=1)  # -> graft(Circle)
dso_2 = DeconstructSpeckleObject(SpeckleObject=receive_3.Materials, selectedKitName="Objects")
trim_2 = TrimTree(Tree=area_3.Centroid, Depth=1)
item_4 = ListItem(List=flatten(mesh_2), Index=Slider(3, range=0..20), Wrap=True)
disc_3 = Discontinuity(Curve=geo, Level=1)  # -> flatten(Points), Parameters
pdecon_3 = Deconstruct(Point=trim_2)  # -> XComponent, YComponent, ZComponent
alongcrv = SortAlongCurve(Points=cps.ClosestPoint, Curve=cir)  # -> Points, Indices
send_2 = Send(
    Stream=panel_10,
    Message="Footprint",
    Data=esokv_2,
    AutoSend=False,
    BaseId="5c085f5baf2f57c841840d9e65b2c551",
    CurrentComponentState="expired",
    KitName="Objects",
    OutputWrappers="https://macad.speckle.xyz\t4975f9f0a8\t123ad7dd3c",
    UseDefaultCache=True,
    selectedKitName="Objects")  # disabled
# Speckle
panel_11 = Panel(dso_2)
preview = CustomPreview(Geometry=boundary, Material=ColourSwatch(SwatchColor=RGB(117, 117, 117)))
item_5 = ListItem(List=pdecon_3.ZComponent, Index=0, Wrap=True)
merge = Merge(Data1=Slider(1, range=0..23), Data2=Slider(1, range=0..23), Data3=Slider(1, range=0..23), Data4=Slider(7, range=0..23))  # -> graft(Result)
pt_3 = Point(<point referenced from the Rhino model>)
pdecon_4 = Deconstruct(Point=pt_3)  # -> XComponent, YComponent, ZComponent
shift = ShiftList(List=alongcrv.Points, Shift=merge, Wrap=True)
panel_12 = Panel(item_5)
pline = PolyLine(Vertices=shift, Closed=True)
roundd = RoundToDecimalPlace(NumberX=pdecon_4.XComponent, DecimalPlace="2", RoundType=0)  # -> Rounded, Difference
roundd_2 = RoundToDecimalPlace(NumberX=pdecon_4.YComponent, DecimalPlace="2", RoundType=0)  # -> Rounded, Difference
boundary_2 = BoundarySurfaces(Edges=pline)
points = PointList(Points=shift, Size=Slider(1, range=0..10))
panel_13 = Panel(roundd.Rounded)
panel_14 = Panel(roundd_2.Rounded)
area_4 = Area(Geometry=boundary_2)  # -> Area, Centroid
pdecon_5 = Deconstruct(Point=area_4.Centroid)  # -> XComponent, YComponent, ZComponent
subtraction = Subtraction(A=item_5, B=pdecon_5.ZComponent)
Z_2 = UnitZ(Factor=subtraction)
move_2 = Move(Geometry=boundary_2, Motion=Z_2)  # -> Geometry, Transform

# ----
# TURN OFF
# BEFORE
# OPENING
# RHINO
# FILE
toggle_2 = GroupToggle(ToggleActive=True, ToggleVisible=False)  # disabled

# ----
# Pavilions Outline - Curved
number_slider_2 = Slider(-0.4, range=-2..2)
brep_6 = Brep(item)
volume_3 = Volume(Geometry=brep_6)  # -> Volume, Centroid
plfit = PlaneFit(Points=flatten(volume_3.Centroid))  # -> Plane, Deviation
Z_3 = UnitZ(Factor=Slider(1.5, range=-5..5))
offset_5 = OffsetCurve(Curve=nurbs_2.Curve, Distance=number_slider_2, Corners=1)
Z_4 = UnitZ(Factor=Slider(-1.2, range=-5..0))
move_3 = Move(Geometry=plfit.Plane, Motion=Z_3)  # -> Geometry, Transform
move_4 = Move(Geometry=plfit.Plane, Motion=Z_4)  # -> Geometry, Transform

Z_5 = UnitZ(Factor=1)
projecta = ProjectAlong(Geometry=offset_4, Plane=move_4.Geometry, Direction=Z_5)  # -> Geometry, Transform

Z_6 = UnitZ(Factor=1)
projecta_2 = ProjectAlong(Geometry=offset_5, Plane=move_3.Geometry, Direction=Z_6)  # -> Geometry, Transform

# ---- group: Solid Difference
toggle_3 = GroupToggle(ToggleActive=True, ToggleVisible=False)  # disabled
number_slider_3 = Slider(5, range=0..10)  # disabled
number_slider_4 = Slider(-0.37, range=-2..0)  # disabled
series_2 = Series(Start=0, Step=number_slider_4, Count=number_slider_3)  # disabled
Z_7 = UnitZ(Factor=series_2)  # disabled
number_slider_5 = Slider(1.5, range=0..20)  # disabled
move_5 = Move(Geometry=reverse(projecta.Geometry), Motion=Z_7)  # -> Geometry, Transform; disabled
number_slider_6 = Slider(0, range=-1..1)  # disabled
Z_8 = UnitZ(Factor=number_slider_5)  # disabled
addition = Addition(A=number_slider_4, B=number_slider_6)  # disabled
move_6 = Move(Geometry=move_5.Geometry, Motion=Z_8)  # -> Geometry, Transform; disabled
Z_9 = UnitZ(Factor=addition)  # disabled
extr = Extrude(Base=move_6.Geometry, Direction=Z_9)  # disabled
cap = CapHoles(Brep=extr)  # disabled
sunion = SolidUnion(Breps=cap)  # disabled

# ----
# Pavilions Ground
projecta_3 = ProjectAlong(Geometry=crv, Plane=move_4.Geometry, Direction=Z_5)  # -> Geometry, Transform
patch = Patch(Points=disc_3.Points, Spans=20, Flexibility=5, Trim=True)
project_3 = Project(Curve=crv, Brep=patch, Direction=Vector(0, 0, 1))
srfsplit = SurfaceSplit(Surface=patch, Curves=project_3)
boundary_3 = BoundarySurfaces(Edges=projecta_3.Geometry)
item_6 = ListItem(List=srfsplit, Index="1", Wrap=True)
swatch = ColourSwatch(SwatchColor=RGB(77, 87, 62))
contour = Contour(Shape=item_6, Point=Point(0, 0, 0), Direction=Vector(0, 0, 1), Distance="0.5")
preview_2 = CustomPreview(Geometry=item_6, Material=ColourSwatch(SwatchColor=RGB(99, 99, 99)))  # disabled

# ----
# Units (Pebbles)
brep_7 = Brep(item)
# Pavilions Outline - Dispatched Points
number_slider_7 = Slider(0, range=0..2)
mesh_3 = MeshBrep(
    Brep=brep_7,
    Settings={GridMaxCount=0, GridMinCount=16, JaggedSeams=False, MaxEdgeLength=0, MinEdgeLength=0.0001, MinTolerance=0, Refine=True, RefineAngle=0, RelativeTolerance=0.65, SimplePlanes=True, Tolerance=0})
wbcatmullclark = WeaverbirdsCatmullClarkSubdivision(MeshCurves=mesh_3, Level=Slider(2, range=0..2), SmoothNakedEdges=number_slider_7)
preview_3 = CustomPreview(Geometry=brep_7, Material=ColourSwatch(SwatchColor=RGBA(189, 189, 189, 205)))  # disabled
preview_4 = CustomPreview(Geometry=wbcatmullclark, Material=ColourSwatch(SwatchColor=RGB(145, 142, 132)))

panel_15 = Panel("""0
0
1""")

# ---- group: Original Wall Control Points
pt_4 = Point(disc_2.Points)

# ----
cull_4 = CullPattern(List=pt_4, CullPattern=invert(panel_15))
cull_5 = CullPattern(List=pt_4, CullPattern=panel_15)
project_4 = ProjectPoint(Point=pt_4, Direction=Vector(0, 0, -1), Geometry=boundary)  # -> Point, Index; disabled
number_slider_8 = Slider(0.3, range=0..1)  # disabled
dots = DotDisplay(Point=project_4.Point, Colour=RGB(0, 0, 0), Size=number_slider_8)  # disabled

crv_cp = CurveClosestPoint(Point=cull_5, Curve=offset_5)  # -> Point, Parameter, Distance
eval = EvaluateCurve(Curve=offset_5, Parameter=crv_cp.Parameter)  # -> Point, Tangent, Angle
rotate = Rotate(Geometry=eval.Tangent, Angle=1.570796327, Plane=PlaneXY(0, 0, 0))  # -> Geometry, Transform
amp = Amplitude(Vector=rotate.Geometry, Amplitude=Slider(4.2, range=-10..10))
vdis = VectorDisplay(Anchor=eval.Point, Vector=rotate.Geometry)
move_7 = Move(Geometry=cull_5, Motion=amp)  # -> Geometry, Transform

crv_cp_2 = CurveClosestPoint(Point=cull_4, Curve=offset_5)  # -> Point, Parameter, Distance
eval_2 = EvaluateCurve(Curve=offset_5, Parameter=crv_cp_2.Parameter)  # -> Point, Tangent, Angle
rotate_2 = Rotate(Geometry=eval_2.Tangent, Angle=1.570796327, Plane=PlaneXY(0, 0, 0))  # -> Geometry, Transform
amp_2 = Amplitude(Vector=rotate_2.Geometry, Amplitude=Slider(-0.5, range=-10..10))
vdis_2 = VectorDisplay(Anchor=eval_2.Point, Vector=rotate_2.Geometry)
move_8 = Move(Geometry=cull_4, Motion=amp_2)  # -> Geometry, Transform

number_slider_9 = Slider(-0.1, range=-5..5)  # disabled

srf = Surface(flatten(Tree({0;0;0;0;0;0}: [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], {0;0;0;1;0;0}: [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], {0;0;0;2;0;0}: [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], {0;0;0;3;0;0}: [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])))

# ---- group: 1s
index = ItemIndex(List=pt_4, Item=cull_5)

# ----
Z_10 = UnitZ(Factor=number_slider_9)  # disabled
previewlw = CustomPreviewLineweights(
    Geometry=contour,
    Shader=ColourSwatch(SwatchColor=RGB(255, 255, 255)),
    Thickness=Slider(3.07, range=0..5),
    Absolute=False)

# ---- group: 2s
index_2 = ItemIndex(List=pt_4, Item=cull_4)

# ----
move_9 = Move(Geometry=srf, Motion=Z_10)  # -> Geometry, Transform; disabled
preview_5 = CustomPreview(Geometry=srf, Material=ColourSwatch(SwatchColor=RGB(242, 255, 0)))  # disabled
replace = ReplaceItems(List=pt_4, Item=move_7.Geometry, Indices=index, Wrap=False)
replace_2 = ReplaceItems(List=replace, Item=move_8.Geometry, Indices=index_2, Wrap=False)
nurbs_3 = NurbsCurve(Vertices=replace_2, Degree=3, Periodic=True)  # -> Curve, Length, Domain
Z_11 = UnitZ(Factor=Slider(3.8, range=-5..15))
move_10 = Move(Geometry=patch, Motion=Z_11)  # -> Geometry, Transform
project_5 = ProjectPoint(Point=replace_2, Direction=Vector(0, 0, -1), Geometry=move_10.Geometry)  # -> Point, Index
Z_12 = UnitZ(Factor=Slider(2.8, range=-5..5))
item_7 = ListItem(List=project_5.Point, Index=index, Wrap=True)
move_11 = Move(Geometry=item_7, Motion=Z_12)  # -> Geometry, Transform
Z_13 = UnitZ(Factor=Slider(1.5, range=-10..10))
project_6 = Project(Curve=offset_5, Brep=patch, Direction=Vector(0, 0, 1))
replace_3 = ReplaceItems(List=project_5.Point, Item=move_11.Geometry, Indices=index, Wrap=False)
Z_14 = UnitZ(Factor=1)  # disabled
project_7 = Project(Curve=offset_5, Brep=patch, Direction=Vector(0, 0, 1))  # -> flatten(Curve)
nurbs_4 = NurbsCurve(Vertices=replace_3, Degree=3, Periodic=True)  # -> Curve, Length, Domain
projecta_4 = ProjectAlong(Geometry=nurbs_3.Curve, Plane=move_3.Geometry, Direction=Z_14)  # -> Geometry, Transform; disabled
move_12 = Move(Geometry=project_6, Motion=Z_13)  # -> Geometry, Transform
project_8 = Project(Curve=nurbs_3.Curve, Brep=move_10.Geometry, Direction=Vector(0, 0, 1))  # disabled
previewlw_2 = CustomPreviewLineweights(
    Geometry=nurbs_4.Curve,
    Shader=ColourSwatch(SwatchColor=RGB(255, 255, 255)),
    Thickness=Slider(6.3, range=0..10),
    Absolute=False)

toggle_4 = GroupToggle(ToggleActive=True, ToggleVisible=False)  # disabled
# Wall
merge_2 = Merge(Data1=flatten(nurbs_4.Curve), Data2=flatten(move_12.Geometry), Data3=flatten(project_7))
loft = Loft(Curves=merge_2, Options={Adjust=False, Closed=False, LoftEnds=0, LoftSimp=0, LoftType=0, Rebuild=10, Refit=0.01})
offsrf = OffsetSurface(Surface=loft, Distance=Slider(-0.3, range=-1..1), BothSides=0, CreateSolid=True)
preview_6 = CustomPreview(Geometry=offsrf, Material=ColourSwatch(SwatchColor=RGB(135, 0, 0)))

# ----
# Openings
crv_2 = Curve([<curve referenced from the Rhino model> x12])
disc_4 = Discontinuity(Curve=crv_2, Level=1)  # -> Points, Parameters
area_5 = Area(Geometry=crv_2)  # -> Area, Centroid
nurbs_5 = NurbsCurve(Vertices=disc_4.Points, Degree=3, Periodic=True)  # -> Curve, Length, Domain
scale = Scale(Geometry=flatten(nurbs_5.Curve), Center=area_5.Centroid, Factor=Slider(0.74, range=0..1))  # -> Geometry, Transform
boundary_4 = BoundarySurfaces(Edges=scale.Geometry)
offsrf_2 = OffsetSurface(Surface=boundary_4, Distance=Slider(2.4, range=-3..5), BothSides=0, CreateSolid=True)
join_3 = BrepJoin(Breps=flatten(offsrf_2))  # -> Breps, Closed
Z_15 = UnitZ(Factor=Slider(-0.4, range=-2..2))
move_13 = Move(Geometry=join_3.Breps, Motion=Z_15)  # -> Geometry, Transform

# ---- group: Anchors
pt_5 = Point([<point referenced from the Rhino model> x7])

# ----
toggle_5 = GroupToggle(ToggleActive=True, ToggleVisible=False)  # disabled
# Roof (All Pavilions)
meshpatch = MeshPatch(OuterBoundary=nurbs_4.Curve, AngleTolerance=0.1, Trimback=False, Divisions=1)
triremesh = TriRemesh(Geometry=meshpatch, Length=Slider(1, range=0..1), Iterations=25)  # -> Triangulation, Dual, Creases
genes = GenePool(Decimals=2, Maximum=10, Minimum=-15, Value=[-9.7, -7.78, -8.02, -8.03, -6.55, -7.83, -6.83])
number_slider_10 = Slider(-9.895, range=-20..10)
nv = NakedVertices(Mesh=triremesh.Triangulation)  # -> ClothedIndex, NakedIndex, ClothedPts, NakedPts
cp = ClosestPoint(Point=pt_5, Cloud=nv.ClothedPts)  # -> ClosestPoint, CPIndex, Distance
Z_16 = UnitZ(Factor=genes)
move_14 = Move(Geometry=cp.ClosestPoint, Motion=Z_16)  # -> Geometry, Transform
vec = VectorXYZ(XComponent=Slider(0, range=-10..10), YComponent=0, ZComponent=Slider(7.79, range=0..10))  # -> Vector, Length
edgelengths = EdgeLengths(Mesh=triremesh.Triangulation, LengthFactor=Slider(0, range=0..1), Strength=Slider(14, range=0..100))
anchor = Anchor(Point=nv.NakedPts, Strength=10000)
anchor_2 = Anchor(Point=cp.ClosestPoint, Target=move_14.Geometry, Strength=10000)
show = Show(G=triremesh.Triangulation)
load = Load(Point=nv.ClothedPts, ForceVector=vec.Vector, Weighting=1)
entwine = Entwine(Branch00=show, Branch01=edgelengths, Branch02=load, Branch03=anchor, Branch04=anchor_2, FlattenInputs=True)
bouncysolver = BouncySolver(GoalObjects=entwine, Reset=Button(), Threshold=1e-15, Tolerance=0.0001, Damping=0.99, Iterations=10, On=Toggle(True))  # -> I, V, O
item_8 = ListItem(List=bouncysolver.O, Index=0, Wrap=True)
medges = MeshEdges(Mesh=item_8)  # -> NakedEdges, InteriorEdges, NonManifoldEdges

previewlw_3 = CustomPreviewLineweights(
    Geometry=medges.InteriorEdges,
    Shader=ColourSwatch(SwatchColor=RGB(0, 0, 0)),
    Thickness=Slider(0.03, range=0..1),
    Absolute=True)
preview_7 = CustomPreview(Geometry=item_8, Material=ColourSwatch(SwatchColor=RGB(143, 120, 96)))  # disabled
# To Revit...  and Beyond
number_slider_11 = Slider(1, range=0..1)
Y = UnitY(Factor=250)
move_15 = Move(Motion=Y)  # -> Geometry, Transform
g_shape = AddDirectShapeGeometry(Category=<missing>, Geometry=move_15.Geometry, TrackingMode=2)  # disabled
trigger = Trigger(Interval=-1000, TimerInterval=1000, Target=topography)

triremesh_2 = TriRemesh(Geometry=mesh, Iterations=25)  # -> Triangulation, Dual, Creases
# Terrain
medges_2 = MeshEdges(Mesh=triremesh_2.Triangulation)  # -> NakedEdges, InteriorEdges, NonManifoldEdges
dom = ConstructDomain(DomainStart=Slider(0.53, range=0..1), DomainEnd=Slider(0.7, range=0..1))
dom_2 = ConstructDomain(DomainStart=Slider(0.46, range=0..1), DomainEnd=Slider(0.57, range=0..1))
dom² = ConstructDomain²(DomainU=dom, DomainV=dom_2)

item_9 = ListItem(List=triremesh_2.Triangulation, Index="1", Wrap=True)
Z_17 = UnitZ(Factor=1)
move_16 = Move(Geometry=item_9, Motion=Z_17)  # -> Geometry, Transform
medges_3 = MeshEdges(Mesh=move_16.Geometry)  # -> NakedEdges, InteriorEdges, NonManifoldEdges
previewlw_4 = CustomPreviewLineweights(
    Geometry=medges_3.NakedEdges,
    Shader=ColourSwatch(SwatchColor=RGB(0, 0, 0)),
    Thickness=Slider(2, range=0..100),
    Absolute=False)

contour_2 = Contour(Shape=item_9, Point=Point(0, 0, 0), Direction=Vector(0, 0, 1), Distance=Slider(1, range=0..50))
patch_2 = Patch(Curves=flatten(contour_2), Spans=20, Flexibility=1, Trim=True)

preview_8 = CustomPreview(Geometry=item_9, Material=ColourSwatch(SwatchColor=RGB(194, 194, 194)))  # disabled
subsrf = Isotrim(Surface=patch_2, Domain=dom²)

debrep_3 = DeconstructBrep(Brep=subsrf)  # -> Faces, Edges, Vertices
contour_3 = Contour(Shape=subsrf, Point=Point(0, 0, 0), Direction=Vector(0, 0, 1), Distance=Slider(1, range=0..50))
join_4 = JoinCurves(Curves=debrep_3.Edges, Preserve=False)
offsrf_3 = OffsetSurface(Surface=subsrf, Distance=Slider(-25, range=-100..0), BothSides=0, CreateSolid=True)  # disabled
project_9 = Project(Curve=offset_4, Brep=subsrf, Direction=Vector(0, 0, 1))  # -> flatten(Curve)

# ---- group: Patch - Terrain
# Terrain & Contours (Patch)
toggle_6 = GroupToggle(ToggleActive=True, ToggleVisible=False)  # disabled
item_10 = ListItem(List=project_9, Index=0, Wrap=True)  # -> Item2, Item1, Item
Z_18 = UnitZ(Factor=Slider(1, range=0..6))
move_17 = Move(Geometry=geo, Motion=Z_18)  # -> Geometry, Transform
plfit_2 = PlaneFit(Points=debrep_3.Vertices)  # -> Plane, Deviation
offset_6 = OffsetCurve(Curve=join_4, Distance=Slider(-5, range=-5..5), Plane=plfit_2.Plane, Corners=1)  # -> flatten(Curve)
merge_3 = Merge(Data1=flatten(move_17.Geometry), Data2=item_10.Item2, Data3=join_4, Data4=offset_6)  # -> flatten(Result)
patch_3 = Patch(Curves=merge_3, Spans=20, Flexibility=Slider(10, range=1..15), Trim=True)
project_10 = Project(Curve=crv, Brep=patch_3, Direction=Vector(0, 0, 1))
srfsplit_2 = SurfaceSplit(Surface=patch_3, Curves=project_10)
item_11 = ListItem(List=srfsplit_2, Index=0, Wrap=True)
contour_4 = Contour(Shape=item_11, Point=Point(0, 0, 0), Direction=Vector(0, 0, 1), Distance="0.5")

# ----
brep_8 = Brep(offsrf_3)  # disabled
sdiff = SolidDifference(BrepsA=brep_8, BrepsB=sunion)
preview_9 = CustomPreview(Geometry=sdiff, Material=ColourSwatch(SwatchColor=RGB(255, 255, 255)))  # disabled

# ---- group: Trimmed
mesh_4 = MeshBrep(
    Brep=item_11,
    Settings={GridMaxCount=0, GridMinCount=16, JaggedSeams=False, MaxEdgeLength=0, MinEdgeLength=0.0001, MinTolerance=0, Refine=True, RefineAngle=0, RelativeTolerance=0.65, SimplePlanes=True, Tolerance=0})

# ---- group: Not Clipped
mesh_5 = MeshBrep(
    Brep=patch_3,
    Settings={GridMaxCount=0, GridMinCount=16, JaggedSeams=False, MaxEdgeLength=0, MinEdgeLength=0.0001, MinTolerance=0, Refine=True, RefineAngle=0, RelativeTolerance=0.65, SimplePlanes=True, Tolerance=0})

# ----
preview_10 = CustomPreview(Geometry=mesh_4, Material=ColourSwatch(SwatchColor=RGB(166, 140, 103)))
triremesh_3 = TriRemesh(Geometry=mesh_5, Length=number_slider_11, Iterations=25)  # -> Triangulation, Dual, Creases
medges_4 = MeshEdges(Mesh=triremesh_3.Triangulation)  # -> NakedEdges, InteriorEdges, NonManifoldEdges
mesh_6 = Mesh(triremesh_3.Triangulation)
unweld = UnweldMesh(Mesh=mesh_6, Angle=degrees(Slider(9, range=0..10)))
topography = AddTopographyMesh(Mesh=unweld, TrackingMode=2)
