# Grasshopper definition assembled_speckle.gh (Grasshopper 1.0.7)
# plug-ins: eleFront, Speckle 2, treesloth01, Pufferfish, Rhino.Inside for Autodesk Revit, Bifocals

# ---- group: RECEIVE MATERIALS
# RECIEVE
# MATERIALS
panel = Panel("https://macad.speckle.xyz/streams/4975f9f0a8/branches/site%2F05-materials")
receive = Receive(
    Stream=panel,
    AutoReceive=False,
    CurrentComponentState="expired",
    ExpandOutput=True,
    LastInfoMessage="James McBennett @ 03/02/2024 01:57:29: Materials 01-03-2024 (id:6ecf38526e)",
    ReceiveOnOpen=False,
    ReceivedCommitId="6ecf38526e",
    StreamWrapper="https://macad.speckle.xyz/streams/4975f9f0a8/branches/site/05-materials",
    selectedKitName="Objects")  # -> Info, Materials
dso = DeconstructSpeckleObject(SpeckleObject=receive.Materials, selectedKitName="Objects")  # -> Inflatable, Insulation, Regolith, Soil, Steel

# ---- group: BIMSC-PROJECT
# Send a message to James M. to add
# new materials. This list will be updated
# for all groups to have a common material
# library and common material names.
panel_2 = Panel("ELEMENTAL MARS")
bimsc_project = Text(panel_2)

# ----
reflay = ReferenceByLayer(LayerName="UnitsRawVolumes", lightweight=False)
volume = Volume(Geometry=reflay)  # -> Volume, Centroid
int = Integer(volume.Volume)
cset = CreateSet(List=int)  # -> Set, Map
cset_2 = CreateSet(List=cset.Map)  # -> Set, Map
mindex = MemberIndex(Set=cset.Map, Member=cset_2.Set)  # -> Index, Count
item = ListItem(List=reflay, Index=mindex.Index, Wrap=True)  # -> simplify(Item)
bang = ExplodeTree(Data=item)  # -> Branch0, Branch1
item_2 = ListItem(List=bang.Branch0, Index=0, Wrap=True)

# ---- group: FLOOR_LEVELS
# Set your 'Project' name, your 'Group'
# number, your 'Volume' Location that
# connect wirelessly.
series = Series(Start=0, Step=1, Count="5")
expression = Expression(x=series, Expression="Format(\"{0:00}\", x)")
concat = Concatenate(FragmentA="L", FragmentB=expression)  # -> simplify(graft(Result))
floor_levels = Text(concat)

# ----
# filter terrain
# add actual units
panel_3 = Panel("Contours")  # disabled
panel_4 = Panel("TopoBrep")  # disabled
# UNITS
panel_5 = Panel("TopoMesh")  # disabled
panel_6 = Panel("BakedStudioMarsTopoMain")  # disabled
list = ValueList({"AngularDimension", "Arc", "Block", "Brep", "Circle", "Curve", "Dimension", "Ellipse", "Extrusion", "Hatch", "Leader", "Line", "LinearDimension", "Mesh", "Point", "Polyline", "Polysurface", "RadialDimension", "Surface", "Text", "TextDot"}, selected="Mesh")  # disabled
reflay_2 = ReferenceByLayer(LayerName=panel_3, lightweight=False)  # disabled
reflay_3 = ReferenceByLayer(LayerName=panel_4, lightweight=False)  # disabled
reflay_4 = ReferenceByLayer(LayerName=panel_5, lightweight=False)  # disabled
reflay_5 = ReferenceByLayer(LayerName=panel_6, lightweight=False)  # disabled
mesh = MeshBrep(
    Brep=reflay_3,
    Settings={GridMaxCount=0, GridMinCount=16, JaggedSeams=False, MaxEdgeLength=0, MinEdgeLength=0.0001, MinTolerance=0, Refine=True, RefineAngle=0, RelativeTolerance=0.65, SimplePlanes=True, Tolerance=0})  # disabled
filtertype = FilterByType(ObjectType=list, Geometry=reflay_5, invertFilter=False, returnNulls=False)  # -> ExcludedGeometry, IncludedGeometry; disabled
brep = Brep(reflay_3)  # disabled
mesh_2 = Mesh(reflay_4)  # disabled
faceb = FaceBoundaries(Mesh=mesh_2)  # disabled
mesh_3 = Mesh(filtertype.IncludedGeometry)  # disabled
faceb_2 = FaceBoundaries(Mesh=mesh_3)  # disabled
boundary = BoundarySurfaces(Edges=faceb)  # disabled
boundary_2 = BoundarySurfaces(Edges=faceb_2)  # disabled
join = BrepJoin(Breps=boundary)  # -> Breps, Closed; disabled
join_2 = BrepJoin(Breps=boundary_2)  # -> Breps, Closed; disabled

# ---- group: BIMSC-ORIGINATOR
bimsc_originator = Text("G06")

# ---- group: WorksForBrepsAndMeshes
list_2 = ValueList({"Srf/Brep": 0, "Mesh": 1}, selected="Mesh")

# ---- group: BIMSC-VOLUME
bimsc_volume = Text("A4")

# ----
# //Send topo meshes to Revit
number_slider = Slider(9, range=0..10)
mesh_4 = Mesh(<mesh referenced from the Rhino model>)
Y = UnitY(Factor=250)
categories = DirectShapeCategories("autodesk.revit.category.local:topography-1.0.0", SearchPattern="topo")
unweld = UnweldMesh(Mesh=mesh_4, Angle=degrees(number_slider))
move = Move(Geometry=mesh_4, Motion=Y)  # -> Geometry, Transform

area = Area(Geometry=bang.Branch1)  # -> Area, Centroid
prox = Proximity3D(Points=area.Centroid, Group="1", MaxRadius="5")  # -> simplify(Links), Topology
clean = CleanTree(RemoveNulls=True, RemoveInvalid=True, RemoveEmpty=True, Tree=prox.Links)
tstat = TreeStatistics(Tree=clean)  # -> Paths, Length, Count
split = SplitTree(Data=simplify(graft(bang.Branch1)), Masks=flatten(tstat.Paths))  # -> flatten(Positive), flatten(Negative)
item_3 = ListItem(List=split.Negative, Index="0", Wrap=True)

topography = AddTopographyMesh(Mesh=unweld, TrackingMode=2)
g_shape = AddDirectShapeGeometry(Category=categories, Geometry=move.Geometry, TrackingMode=2)

renumber = RenumberPaths(Data=clean)
end = EndPoints(Curve=renumber)  # -> Start, End
pdecon = Deconstruct(Point=[end.Start, end.End])  # -> XComponent, YComponent, ZComponent
int_2 = Integer(pdecon.ZComponent)
bnd = Bounds(Numbers=int_2)
dedomain = DeconstructDomain(Domain=bnd)  # -> Start, End
equals = Equality(FirstNumber=int_2, SecondNumber=dedomain.Start)  # -> Equality, Inequality
subtraction = Subtraction(A=dedomain.Start, B=dedomain.End)
cull = CullPattern(List=[end.Start, end.End], CullPattern=equals.Equality)
division = Division(A=subtraction, B="2")
abs = Absolute(Value=subtraction)
Z = UnitZ(Factor=division)
wires = BrepWireframe(Brep=split.Positive, Density=-1)
move_2 = Move(Geometry=cull, Motion=Z)  # -> Geometry, Transform
project = Project(Geometry=wires, Plane=move_2.Geometry)  # -> simplify(Geometry), Transform

pt = Point([Point(5066.532651, 6913.387236, 6094.804419), Point(5063.175298, 6904.539869, 6094.804419), Point(5054.545257, 6900.657843, 6094.804419), Point(5083.485387, 6931.389317, 6097.804419), Point(5041.815864, 6912.645237, 6094.804419), Point(5048.530571, 6930.339972, 6097.804419)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])  # disabled
pt_2 = Point(Point(5066.532651, 6913.387236, 6094.804419))  # disabled
pt_3 = Point(Point(5066.686324, 6908.268222, 6094.804419))  # disabled
pt_4 = Point([Point(5066.686324, 6908.268222, 6094.804419), Point(5059.664272, 6900.811516, 6094.804419), Point(5083.63906, 6926.270303, 6097.804419), Point(5065.636979, 6943.223038, 6100.804419), Point(5023.967457, 6924.478958, 6097.804419), Point(5076.617007, 6918.813597, 6097.804419)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])  # disabled
pt_5 = Point(Point(5049.426243, 6900.50417, 6093.304419))  # disabled
pt_6 = Point(flatten([Point(5049.426243, 6900.50417, 6093.304419), Point(5049.426243, 6900.50417, 6093.304419), Point(5048.684244, 6925.220957, 6096.304419), Point(5041.969537, 6907.526223, 6093.304419), Point(5041.662191, 6917.764251, 6096.304419), Point(5048.684244, 6925.220957, 6096.304419)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]))  # disabled

cullpt = CullDuplicates(Points=pt_4, Tolerance=0.1, CullMode=3)  # -> Points, Indices, Valence; disabled
cullpt_2 = CullDuplicates(Points=pt_6, Tolerance=0.1, CullMode=3)  # -> Points, Indices, Valence; disabled

# ----
# ORIENT 3 BLOCKS (ANDRES SCRIPT)
listblockd = ListBlocksInDocument(fullName=True)  # disabled
panel_7 = Panel(listblockd)  # disabled
refblock = ReferenceBlockByName(BlockName=listblockd, getNestedBlocks=False, lightweight=False)  # disabled
bang_2 = ExplodeTree(Data=refblock)  # -> Branch0, Branch1, Branch2; disabled
move2pt = MoveToPoint(Geometry=bang_2.Branch1, PointA=pt_5, PointB=cullpt_2.Points)  # -> flatten(Moved), Vector, Transform; disabled
move2pt_2 = MoveToPoint(Geometry=bang_2.Branch2, PointA=pt_2, PointB=pt)  # -> flatten(Moved), Vector, Transform; disabled
move2pt_3 = MoveToPoint(Geometry=bang_2.Branch0, PointA=pt_3, PointB=cullpt.Points)  # -> flatten(Moved), Vector, Transform; disabled
button = Button()  # disabled
entwine = Entwine(Branch00=move2pt_3.Moved, Branch01=move2pt.Moved, Branch02=move2pt_2.Moved, FlattenInputs=True)  # disabled
bake = BakeObjects(Geometry=entwine, Bake=button, createGroups=False)  # -> Message, Ghosts; disabled

viewer = ParamViewer(refblock)  # disabled

end_2 = EndPoints(Curve=project.Geometry)  # -> Start, End
multiplication = Multiplication(A=abs, B="2")
cullpt_3 = CullDuplicates(Points=[end_2.Start, end_2.End], Tolerance=0.1, CullMode=3)  # -> Points, Indices, Valence
pline = PolyLine(Vertices=cullpt_3.Points, Closed=True)  # -> simplify(Polyline)
Z_2 = UnitZ(Factor=multiplication)
extr = Extrude(Base=pline, Direction=Z_2)
cap = CapHoles(Brep=extr)

volume_2 = Volume(Geometry=bang.Branch0)  # -> Volume, Centroid
# //Send block instances to Revit
listblockd_2 = ListBlocksInDocument(fullName=True)  # disabled
refblock_2 = ReferenceBlockByName(BlockName=listblockd_2, getNestedBlocks=False, lightweight=False)  # disabled
item_4 = ListItem(List=refblock_2, Index=0, Wrap=True)  # disabled
block_info = GetBlockInfo(Block=item_4)  # -> Name, Plane, Transform, BlockType, FilePath, Active; disabled
viewer_2 = ParamViewer(refblock_2)  # disabled
orient = Orient(Geometry=item_4, Source=block_info.Plane, Target=PlaneXY(0, 0, 0))  # -> Geometry, Transform; disabled
mesh_5 = MeshBrep(Settings={GridMaxCount=0, GridMinCount=16, JaggedSeams=False, MaxEdgeLength=0, MinEdgeLength=0.0001, MinTolerance=0, Refine=True, RefineAngle=0, RelativeTolerance=0.65, SimplePlanes=True, Tolerance=0})  # disabled
expblock = ExplodeBlock(Block=orient.Geometry, recursive=False)  # -> Name, Transform, Geometry; disabled

# ----
# //Query materials' names using Elefront
geo = Geometry(expblock.Geometry)  # disabled
ef_att = EleFrontAttributes(Attributes=geo)  # disabled
ef_layer = EleFrontLayer(Layer=ef_att)  # disabled
ef_layer_2 = EleFrontLayer(Layer=ef_layer)  # disabled

panel_8 = Panel(geo)  # disabled
group = Group()
panel_9 = Panel(expblock.Name)  # disabled
clean_2 = CleanTree(RemoveNulls=True, RemoveInvalid=True, RemoveEmpty=False, Tree=ef_layer_2)  # disabled

# ---- group: units centroids
pt_7 = Point(volume_2.Centroid)

# ----
group_2 = Group()
trigger = Trigger(Interval=-1000, TimerInterval=1000, Target=[famform, new, types, l_component, graphics, material])  # disabled
group_3 = Group()
materials = QueryMaterials(Name=ef_layer_2)  # disabled
panel_10 = Panel(materials)  # disabled

# ----
# 02// Create new component family
panel_11 = Panel("C:\Users\paude\Documents\00. Backup 2023\EXTERIOR\MASTER\MA IAAC\03. Cursada\01. Modulo 02\STUDIO\G06_studio_2024\__useful scripts\BIMSC-RIR-Tutorial-Files\FTemplate_GEN_WorkPlane.rft")  # disabled
famform = ComponentFamilyForm(Brep=graft(geo), Material=materials)  # disabled
toggle = BooleanToggle(True)  # disabled
shift = ShiftPaths(Data=famform, Offset=-1)  # disabled
new = NewComponentFamily(Template=panel_11, Overwrite=toggle, Name=expblock.Name, Geometry=shift)  # disabled

# ----
# 03//Add components to RH Planes
types = QueryTypes(Kind=3, FamilyName=expblock.Name)  # disabled
block_info_2 = GetBlockInfo(Block=refblock_2)  # -> Name, Plane, Transform, BlockType, FilePath, Active; disabled
l_component = AddComponentLocation(Location=block_info_2.Plane, Type=types, TrackingMode=2)  # disabled

# ----
# Phasing
number_slider_2 = Slider(7, range=1..7)
series_2 = Series(Start=1, Step=1, Count=number_slider_2)
item_5 = ListItem(List=series_2, Index=0, Wrap=True)  # -> Item, Item1, Item2, Item3, Item4, Item5, Item6

# ---- group: PHASE
num = Number(item_5.Item3)

num_2 = Number(item_5.Item2)

# PHASE 1 - NO HUMANS
# EDIT SITE MESH
num_3 = Number(item_5.Item)

num_4 = Number(item_5.Item1)

num_5 = Number(item_5.Item4)

num_6 = Number(item_5.Item5)

# PHASE 2 - HUMANS / MACHINE COLLABORATION
num_7 = Number(item_5.Item6)

# ----
panel_12 = Panel("https://macad.speckle.xyz/streams/4975f9f0a8/branches/site/04-community-site")
receive_2 = Receive(
    Stream=panel_12,
    AutoReceive=False,
    CurrentComponentState="expired",
    ExpandOutput=True,
    LastInfoMessage="James McBennett @ 03/01/2024 23:14:17: 2024 Mar-01 (id:9ec35295b2)",
    ReceiveOnOpen=False,
    ReceivedCommitId="9ec35295b2",
    StreamWrapper="https://macad.speckle.xyz/streams/4975f9f0a8/branches/site/04-community-site",
    selectedKitName="Objects")  # -> Info, CONTOURS, SOIL
item_6 = ListItem(List=flatten(receive_2.SOIL), Index=Slider(3, range=0..17), Wrap=True)
srf = Surface(<surface referenced from the Rhino model>)
bbox = BoundingBox(Content=srf, Plane=PlaneXY(0, 0, 0))  # -> Box, Box_2
volume_3 = Volume(Geometry=bbox.Box)  # -> Volume, Centroid
msphere = MeshSphere(Base=volume_3.Centroid, Radius="80", UCount="100", VCount="100")
mmx = MeshMesh(MeshA=item_6, MeshB=msphere)
msplit = MeshSplit(Mesh=item_6, Splitters=msphere)

# ----
# WALLS
panel_13 = Panel("Wall")
reflay_6 = ReferenceByLayer(LayerName=panel_13, lightweight=False, DisableAutoUpdate=False)
panel_14 = Panel(reflay_6)
mesh_6 = MeshBrep(
    Brep=reflay_6,
    Settings={GridMaxCount=0, GridMinCount=16, JaggedSeams=False, MaxEdgeLength=0, MinEdgeLength=0.0001, MinTolerance=0, Refine=True, RefineAngle=0, RelativeTolerance=0.65, SimplePlanes=True, Tolerance=0})
brep_2 = Brep(reflay_6)
mjoin = MeshJoin(Meshes=mesh_6)
weld = WeldMesh(Mesh=mjoin, Angle=3.141592654)

# ----
# ROOFS
panel_15 = Panel("Roof")
reflay_7 = ReferenceByLayer(LayerName=panel_15, lightweight=False, DisableAutoUpdate=False)
panel_16 = Panel(reflay_7)
mesh_7 = Mesh(reflay_7)
faceb_3 = FaceBoundaries(Mesh=mesh_7)
boundary_3 = BoundarySurfaces(Edges=faceb_3)
join_3 = BrepJoin(Breps=boundary_3)  # -> Breps, Closed
mesh_8 = Mesh(reflay_7)

# ----
# TERRAIN
panel_17 = Panel("TopoMesh")
reflay_8 = ReferenceByLayer(LayerName=panel_17, lightweight=False, DisableAutoUpdate=False)
reflay_9 = ReferenceByLayer(LayerName="TopoBrep", lightweight=False, DisableAutoUpdate=False)
panel_18 = Panel([reflay_8, reflay_9])

# ----
# FLOORS
panel_19 = Panel("Floors")
reflay_10 = ReferenceByLayer(LayerName=panel_19, lightweight=False, DisableAutoUpdate=False)
panel_20 = Panel(reflay_10)
mesh_9 = MeshBrep(
    Brep=reflay_10,
    Settings={GridMaxCount=0, GridMinCount=16, JaggedSeams=False, MaxEdgeLength=0, MinEdgeLength=0.0001, MinTolerance=0, Refine=True, RefineAngle=0, RelativeTolerance=0.65, SimplePlanes=True, Tolerance=0})
brep_3 = Brep(reflay_10)
mjoin_2 = MeshJoin(Meshes=mesh_9)
weld_2 = WeldMesh(Mesh=mjoin_2, Angle=3.141592654)

reflay_11 = ReferenceByLayer(LayerName="Pods", lightweight=False, DisableAutoUpdate=False)
panel_21 = Panel(reflay_11)
mesh_10 = MeshBrep(
    Brep=reflay_11,
    Settings={GridMaxCount=0, GridMinCount=16, JaggedSeams=False, MaxEdgeLength=0, MinEdgeLength=0.0001, MinTolerance=0, Refine=True, RefineAngle=0, RelativeTolerance=0.65, SimplePlanes=True, Tolerance=0})
brep_4 = Brep(reflay_11)
mjoin_3 = MeshJoin(Meshes=mesh_10)
weld_3 = WeldMesh(Mesh=mjoin_3, Angle=3.141592654)

# ---- group: LEVEL
floor_levels_2 = Text(floor_levels)

# ----
filter = StreamFilter(Gate=list_2, Stream0=reflay_9, Stream1=reflay_8)
msplit_2 = MeshSplit(Mesh=filter, Splitters=msphere)
item_7 = ListItem(List=msplit_2, Index=Slider(1, range=0..1), Wrap=True)
name = ExtendSpeckleObject(
    SpeckleObject=item_7,
    BIMSCPROJECT=bimsc_project,
    BIMSCORIGINATOR=bimsc_originator,
    BIMSCVOLUME=bimsc_volume,
    BIMSCLEVEL=floor_levels_2,
    BIMSCTYPE="TERRAIN",
    BIMSCMATERIAL="soil",
    RenderMaterial=dso.Soil,
    BIMSCPHASE=num_3,
    selectedKitName="Objects")  # -> flatten(ExtendedSpeckleObject)

# ---- group: LEVEL
floor_levels_3 = Text(floor_levels)

# ----
filter_2 = StreamFilter(Gate=list_2, Stream0=brep_3, Stream1=weld_2)
name_2 = ExtendSpeckleObject(
    SpeckleObject=filter_2,
    BIMSCPROJECT=bimsc_project,
    BIMSCORIGINATOR=bimsc_originator,
    BIMSCVOLUME=bimsc_volume,
    BIMSCLEVEL=floor_levels_3,
    BIMSCTYPE="FLOORS",
    BIMSCMATERIAL="Regolith",
    RenderMaterial=dso.Regolith,
    BIMSCPHASE=num_4,
    selectedKitName="Objects")  # -> flatten(ExtendedSpeckleObject)

# ---- group: LEVEL
floor_levels_4 = Text(floor_levels)

# ----
filter_3 = StreamFilter(Gate=list_2, Stream0=brep_4, Stream1=weld_3)
name_3 = ExtendSpeckleObject(
    SpeckleObject=filter_3,
    BIMSCPROJECT=bimsc_project,
    BIMSCORIGINATOR=bimsc_originator,
    BIMSCVOLUME=bimsc_volume,
    BIMSCLEVEL=floor_levels_4,
    BIMSCTYPE="PODS",
    BIMSCMATERIAL="Regolith",
    RenderMaterial=dso.Regolith,
    BIMSCPHASE=num_2,
    selectedKitName="Objects")  # -> flatten(ExtendedSpeckleObject)

# ---- group: LEVEL
floor_levels_5 = Text(floor_levels)

floor_levels_6 = Text(floor_levels)

txt = Text(Tree({0}: ["L00"], {1}: ["L04"]))

# ----
filter_4 = StreamFilter(Gate=list_2, Stream0=join_3.Breps, Stream1=mesh_8)  # -> reverse(simplify(graft(Stream)))
name_4 = ExtendSpeckleObject(
    SpeckleObject=filter_4,
    BIMSCPROJECT=bimsc_project,
    BIMSCORIGINATOR=bimsc_originator,
    BIMSCVOLUME=bimsc_volume,
    BIMSCLEVEL=txt,
    BIMSCTYPE="ROOF",
    BIMSCMATERIAL="Inflatable",
    RenderMaterial=dso.Inflatable,
    BIMSCPHASE=num_7,
    selectedKitName="Objects")

# ---- group: LEVEL
txt_2 = Text(Tree({0}: ["L00"], {1}: ["L04"]))

# ----
filter_5 = StreamFilter(Gate=list_2, Stream0=brep_2, Stream1=weld)  # -> reverse(simplify(graft(Stream)))
name_5 = ExtendSpeckleObject(
    SpeckleObject=filter_5,
    BIMSCPROJECT=bimsc_project,
    BIMSCORIGINATOR=bimsc_originator,
    BIMSCVOLUME=bimsc_volume,
    BIMSCLEVEL=txt_2,
    BIMSCTYPE="WALLS",
    BIMSCMATERIAL="Regolith",
    RenderMaterial=dso.Regolith,
    BIMSCPHASE=num_6,
    selectedKitName="Objects")

# ---- group: LEVEL
floor_levels_7 = Text(floor_levels)

# ----
item_8 = ListItem(List=msplit, Index=Slider(0, range=0..1), Wrap=True)
name_6 = ExtendSpeckleObject(
    SpeckleObject=item_8,
    BIMSCPROJECT=bimsc_project,
    BIMSCORIGINATOR=bimsc_originator,
    BIMSCVOLUME=bimsc_volume,
    BIMSCLEVEL=floor_levels_7,
    BIMSCTYPE="SITE",
    BIMSCMATERIAL="soil",
    RenderMaterial=dso.Soil,
    BIMSCPHASE=num_3,
    selectedKitName="Objects")  # -> flatten(ExtendedSpeckleObject)

number_slider_3 = Slider(1.5, range=1..2)
range = Range(Domain=Slider(1.5, range=0..6.002), Steps=number_slider_3)
range_2 = Range(Domain=Domain(0, 1), Steps=number_slider_3)
graph = GraphMapper(range_2, x0=0, x1=1, y0=0, y1=1, container_name="Bezier", cpx=[0, 0.5185281634, 1, 1], cpy=[0, 0, 0.1436586976, 1])
pt_8 = ConstructPoint(XCoordinate=0, YCoordinate=0, ZCoordinate=range)
dom = ConstructDomain(DomainStart=Slider(2, range=1..13), DomainEnd=Slider(0.7, range=0..2.02))
bnd_2 = Bounds(Numbers=graph)
prot = RotatePlane(Plane=pt_8, Angle="0.5*pi")
remap = RemapNumbers(Value=graph, Source=bnd_2, Target=dom)  # -> Mapped, Clipped
cir = Circle(Plane=pt_8, Radius=remap.Mapped)
item_9 = ListItem(List=cir, Index=0, Wrap=True)
area_2 = Area(Geometry=item_9)  # -> Area, Centroid
number_slider_4 = Slider(0.01, range=0..1)
range_3 = Range(Domain=Domain(0, 1), Steps=Slider(4, range=0..50))
shatter = Shatter(Curve=reparameterize(graft(cir)), Parameters=range_3)
subtraction_2 = Subtraction(A="1", B=number_slider_4)
merge = Merge(Data1="0", Data2=number_slider_4, Data3=subtraction_2, Data4="1")
consec = ConsecutiveDomains(Numbers=merge, Additive=invert(True))
panel_22 = Panel(merge)
subcrv = SubCurve(BaseCurve=reparameterize(graft(shatter)), Domain=consec)
panel_23 = Panel("""0
2""")
panel_24 = Panel(consec)
cull_i = CullIndex(List=subcrv, Indices=panel_23, Wrap=True)  # -> simplify(List)
item_10 = ListItem(List=subcrv, Index=panel_23, Wrap=True)
pshift = ShiftPaths(Data=cull_i, Offset=-1)
flip = FlipMatrix(Data=pshift)
midpt = CurveMiddle(Curve=flip)
loft = Loft(Curves=cir, Options={Adjust=False, Closed=False, LoftEnds=0, LoftSimp=0, LoftType=0, Rebuild=10, Refit=0.01})
pshift_2 = ShiftPaths(Data=item_10, Offset=-1)
graph_2 = GraphMapper(range_2, x0=0, x1=1, y0=0, y1=1, container_name="Bezier", cpx=[0, 0.25, 0.75, 1], cpy=[0, 0.25, 0.75, 1])
join_4 = JoinCurves(Curves=pshift_2, Preserve=False)
brep_cp = BrepClosestPoint(Point=midpt, Brep=loft)  # -> Point, Normal, Distance
dom_2 = ConstructDomain(DomainStart=Slider(0.1, range=0..10), DomainEnd=Slider(0.11, range=0..1))
flip_2 = FlipMatrix(Data=join_4)
bnd_3 = Bounds(Numbers=graph_2)
remap_2 = RemapNumbers(Value=graph_2, Source=bnd_3, Target=dom_2)  # -> Mapped, Clipped
amp = Amplitude(Vector=brep_cp.Normal, Amplitude=remap_2.Mapped)
rev = Reverse(Vector=amp)
end_3 = EndPoints(Curve=flip)  # -> Start, End
move_3 = Move(Geometry=midpt, Motion=rev)  # -> Geometry, Transform
arc = Arc3Pt(PointA=end_3.Start, PointB=move_3.Geometry, PointC=end_3.End)  # -> Arc, Plane, Radius
item_11 = ListItem(List=arc.Arc, Index=0, Wrap=True)
project_2 = Project(Geometry=item_11, Plane=PlaneXY(0, 0, 0))  # -> Geometry, Transform
loft_opt = LoftOptions(Closed=False, Adjust=False, Rebuild=0, Refit="0.01", Type=0)
replace = ReplaceItems(List=arc.Arc, Item=project_2.Geometry, Indices="0", Wrap=False)
loft_2 = Loft(Curves=flip_2, Options=loft_opt)
loft_3 = Loft(Curves=replace, Options=loft_opt)
entwine_2 = Entwine(Branch00=loft_3, Branch01=loft_2, FlattenInputs=True)
brep_5 = Brep(item_2)
merge_2 = Merge(Data1=ColourSwatch(SwatchColor=RGBA(107, 107, 107, 206)), Data2=ColourSwatch(SwatchColor=RGB(255, 255, 255)))  # -> simplify(graft(Result))
python = GhPythonScript(S=entwine_2, D=Slider(0.01, range=0..1))  # -> simplify(a); inputs S: Brep
# ---------- python: Python ----------
import rhinoscriptsyntax as rs

a = rs.OffsetSurface(S, D, None, False, True)
# ---------- end python ----------
flatten = FlattenTree(Tree=python, Path="{0}")

Z_3 = UnitZ(Factor=expr("-x", Slider(0.1, range=0..10)))
item_12 = ListItem(List=cir, Index="-1", Wrap=True)
extr_2 = Extrude(Base=item_12, Direction=Z_3)
cap_2 = CapHoles(Brep=extr_2)

item_13 = ListItem(List=brep_5, Index=0, Wrap=True)

volume_4 = Volume(Geometry=item_13)  # -> Volume, Centroid
move2pt_4 = MoveToPoint(Geometry=flatten, PointA=area_2.Centroid, PointB=graft(volume_4.Centroid))  # -> simplify(Moved), Vector, Transform
lng = ListLength(List=move2pt_4.Moved)
graft = GraftTree(Tree=volume_4.Centroid, IncludeEmptyLists=True, IncludeNullItems=True)  # -> simplify(Tree)
group_4 = Group(Objects=move2pt_4.Moved)
split_2 = SplitList(List=move2pt_4.Moved, Index=expr("x/2", lng))  # -> flatten(ListA), flatten(ListB)
mirror = Mirror(Geometry=group_4, Plane=graft)  # -> Geometry, Transform
ungroup = Ungroup(Group=mirror.Geometry)
move2pt_5 = MoveToPoint(Geometry=cap_2, PointA=area_2.Centroid, PointB=graft(volume_4.Centroid))  # -> Moved, Vector, Transform
split_3 = SplitList(List=ungroup, Index=expr("x/2", lng))  # -> flatten(ListA), flatten(ListB)
entwine_3 = Entwine(Branch00=split_2.ListA, Branch01=split_2.ListB, FlattenInputs=True)  # -> simplify(Result)
entwine_4 = Entwine(Branch00=split_3.ListA, Branch01=split_3.ListB, FlattenInputs=True)  # -> simplify(Result)
merge_3 = Merge(Data1=entwine_3, Data2=entwine_4)

data = Data([split_2.ListB, split_3.ListB])
data_2 = Data([split_2.ListA, split_3.ListA])
qrmesh = QuadRemesh(Mesh=data_2, Settings={aqc=True, as=50, dhe=True, gci=0, null=False, pme=0, sa=0, tqc=2000})  # -> graft(QuadResult)
qrmesh_2 = QuadRemesh(Mesh=data, Settings={aqc=True, as=50, dhe=True, gci=0, null=False, pme=0, sa=0, tqc=2000})

# ---- group: unit centroid
pt_9 = Point(volume_4.Centroid)

# ----
group_5 = Group(Objects=qrmesh)
group_6 = Group(Objects=qrmesh_2)
group_7 = Group(Objects=flatten([group_6, group_2]))
move2pt_6 = MoveToPoint(Geometry=move2pt_5.Moved, PointA=pt_9, PointB=pt_7)  # -> flatten(Moved), Vector, Transform
move2pt_7 = MoveToPoint(Geometry=qrmesh_2, PointA=pt_9, PointB=graft(pt_7))  # -> flatten(Moved), Vector, Transform
move2pt_8 = MoveToPoint(Geometry=qrmesh, PointA=pt_9, PointB=pt_7)  # -> flatten(Moved), Vector, Transform
merge_4 = Merge(Data1=move2pt_6.Moved, Data2=move2pt_7.Moved)

number_slider_5 = Slider(1.5, range=1..2)
range_4 = Range(Domain=Slider(1.5, range=0..6.002), Steps=number_slider_5)
range_5 = Range(Domain=Domain(0, 1), Steps=number_slider_5)
graph_3 = GraphMapper(range_5, x0=0, x1=1, y0=0, y1=1, container_name="Bezier", cpx=[0, 0.5185281634, 1, 1], cpy=[0, 0, 0.1436586976, 1])
pt_10 = ConstructPoint(XCoordinate=0, YCoordinate=0, ZCoordinate=range_4)
dom_3 = ConstructDomain(DomainStart=Slider(3.9, range=1..13), DomainEnd=Slider(1.2, range=0..2.02))
bnd_4 = Bounds(Numbers=graph_3)
prot_2 = RotatePlane(Plane=pt_10, Angle="0.5*pi")
remap_3 = RemapNumbers(Value=graph_3, Source=bnd_4, Target=dom_3)  # -> Mapped, Clipped
number_slider_6 = Slider(0.01, range=0..1)
cir_2 = Circle(Plane=prot_2, Radius=remap_3.Mapped)
item_14 = ListItem(List=cir_2, Index=0, Wrap=True)
area_3 = Area(Geometry=item_14)  # -> Area, Centroid
subtraction_3 = Subtraction(A="1", B=number_slider_6)
range_6 = Range(Domain=Domain(0, 1), Steps=Slider(8, range=0..50))
merge_5 = Merge(Data1="0", Data2=number_slider_6, Data3=subtraction_3, Data4="1")
shatter_2 = Shatter(Curve=reparameterize(graft(cir_2)), Parameters=range_6)
consec_2 = ConsecutiveDomains(Numbers=merge_5, Additive=invert(True))
panel_25 = Panel(merge_5)
subcrv_2 = SubCurve(BaseCurve=reparameterize(graft(shatter_2)), Domain=consec_2)
panel_26 = Panel("""0
2""")
panel_27 = Panel(consec_2)
cull_i_2 = CullIndex(List=subcrv_2, Indices=panel_26, Wrap=True)  # -> simplify(List)
item_15 = ListItem(List=subcrv_2, Index=panel_26, Wrap=True)
pshift_3 = ShiftPaths(Data=cull_i_2, Offset=-1)
flip_3 = FlipMatrix(Data=pshift_3)
midpt_2 = CurveMiddle(Curve=flip_3)
loft_4 = Loft(Curves=cir_2, Options={Adjust=False, Closed=False, LoftEnds=0, LoftSimp=0, LoftType=0, Rebuild=10, Refit=0.01})
pshift_4 = ShiftPaths(Data=item_15, Offset=-1)
graph_4 = GraphMapper(range_5, x0=0, x1=1, y0=0, y1=1, container_name="Bezier", cpx=[0, 0.25, 0.75, 1], cpy=[0, 0.25, 0.75, 1])
join_5 = JoinCurves(Curves=pshift_4, Preserve=False)
brep_cp_2 = BrepClosestPoint(Point=midpt_2, Brep=loft_4)  # -> Point, Normal, Distance
dom_4 = ConstructDomain(DomainStart=Slider(0.1, range=0..10), DomainEnd=Slider(0.11, range=0..1))
flip_4 = FlipMatrix(Data=join_5)
bnd_5 = Bounds(Numbers=graph_4)
remap_4 = RemapNumbers(Value=graph_4, Source=bnd_5, Target=dom_4)  # -> Mapped, Clipped
amp_2 = Amplitude(Vector=brep_cp_2.Normal, Amplitude=remap_4.Mapped)
rev_2 = Reverse(Vector=amp_2)
end_4 = EndPoints(Curve=flip_3)  # -> Start, End
move_4 = Move(Geometry=midpt_2, Motion=rev_2)  # -> Geometry, Transform
arc_2 = Arc3Pt(PointA=end_4.Start, PointB=move_4.Geometry, PointC=end_4.End)  # -> Arc, Plane, Radius
item_16 = ListItem(List=arc_2.Arc, Index=0, Wrap=True)
project_3 = Project(Geometry=item_16, Plane=PlaneXY(0, 0, 0))  # -> Geometry, Transform
loft_opt_2 = LoftOptions(Closed=False, Adjust=False, Rebuild=0, Refit="0.01", Type=0)
replace_2 = ReplaceItems(List=arc_2.Arc, Item=project_3.Geometry, Indices="0", Wrap=False)
loft_5 = Loft(Curves=flip_4, Options=loft_opt_2)
loft_6 = Loft(Curves=replace_2, Options=loft_opt_2)
entwine_5 = Entwine(Branch00=loft_6, Branch01=loft_5, FlattenInputs=True)
merge_6 = Merge(Data1=ColourSwatch(SwatchColor=RGBA(189, 189, 189, 206)), Data2=ColourSwatch(SwatchColor=RGB(255, 255, 255)))  # -> simplify(graft(Result))
python_2 = GhPythonScript(S=entwine_5, D=Slider(0.01, range=0..1))  # -> simplify(a); inputs S: Brep; same code as python
brep_6 = Brep(item_3)
volume_5 = Volume(Geometry=brep_6)  # -> Volume, Centroid
flatten_2 = FlattenTree(Tree=python_2, Path="{0}")
move2pt_9 = MoveToPoint(Geometry=flatten_2, PointA=area_3.Centroid, PointB=graft(volume_5.Centroid))  # -> simplify(Moved), Vector, Transform
lng_2 = ListLength(List=move2pt_9.Moved)
graft_2 = GraftTree(Tree=volume_5.Centroid, IncludeEmptyLists=True, IncludeNullItems=True)  # -> simplify(Tree)
group_8 = Group(Objects=move2pt_9.Moved)
split_4 = SplitList(List=move2pt_9.Moved, Index=expr("x/2", lng_2))  # -> flatten(ListA), flatten(ListB)
mirror_2 = Mirror(Geometry=group_8, Plane=graft_2)  # -> Geometry, Transform
ungroup_2 = Ungroup(Group=mirror_2.Geometry)
brep_7 = Brep(split.Negative)
entwine_6 = Entwine(Branch00=split_4.ListA, Branch01=split_4.ListB, FlattenInputs=True)  # -> simplify(Result)
split_5 = SplitList(List=ungroup_2, Index=expr("x/2", lng_2))  # -> flatten(ListA), flatten(ListB)
volume_6 = Volume(Geometry=brep_7)  # -> Volume, Centroid
cull_i_3 = CullIndex(List=volume_6.Centroid, Indices="0", Wrap=True)
entwine_7 = Entwine(Branch00=split_5.ListA, Branch01=split_5.ListB, FlattenInputs=True)  # -> simplify(Result)
merge_7 = Merge(Data1=entwine_6, Data2=entwine_7)

Z_4 = UnitZ(Factor=expr("-x", Slider(0.1, range=0..10)))
item_17 = ListItem(List=cir_2, Index="-1", Wrap=True)
extr_3 = Extrude(Base=item_17, Direction=Z_4)
cap_3 = CapHoles(Brep=extr_3)

move2pt_10 = MoveToPoint(Geometry=cap_3, PointA=area_3.Centroid, PointB=graft(volume_5.Centroid))  # -> Moved, Vector, Transform

data_3 = Data([split_4.ListB, split_5.ListB])
data_4 = Data([split_4.ListA, split_5.ListA])
qrmesh_3 = QuadRemesh(Mesh=data_4, Settings={aqc=True, as=50, dhe=True, gci=0, null=False, pme=0, sa=0, tqc=2000})  # -> graft(QuadResult)

# ---- group: unit centroid
pt_11 = Point(volume_5.Centroid)

# ----
debrep = DeconstructBrep(Brep=brep_6)  # -> Faces, Edges, Vertices
area_4 = Area(Geometry=debrep.Faces)  # -> Area, Centroid
panel_28 = Panel("""0
3""")
item_18 = ListItem(List=flatten(area_4.Centroid), Index=panel_28, Wrap=True)
rotate = Rotate(Geometry=item_18, Angle=degrees("22.5"), Plane=pt_11)  # -> Geometry, Transform
ln = Line(StartPoint=rotate.Geometry, EndPoint=pt_11)
ext = ExtendCurve(Curve=ln, Type=0, Start=Slider(2, range=0..10), End=Slider(0, range=0..10))
pframe = PerpFrame(Curve=reparameterize(ext), Parameter="0.5")  # -> graft(Frame)
pipe = Pipe(Curve=ext, Radius=1, Caps=0)
scale_nu = ScaleNU(Geometry=pipe, Plane=pframe, ScaleX=1, ScaleY=Slider(0.7, range=0..1), ScaleZ=1)  # -> Geometry, Transform
panel_29 = Panel(pframe)
cap_4 = CapHoles(Brep=scale_nu.Geometry)
mesh_11 = Mesh(cap_4)
msplit_3 = MeshSplit(Mesh=flatten(qrmesh_3), Splitters=flatten(mesh_11))
item_19 = ListItem(List=msplit_3, Index=Slider(0, range=0..100), Wrap=True)

# ---- group: units centroids
pt_12 = Point(volume_6.Centroid)

# ----
qrmesh_4 = QuadRemesh(Mesh=data_3, Settings={aqc=True, as=50, dhe=True, gci=0, null=False, pme=0, sa=0, tqc=2000})
group_9 = Group(Objects=qrmesh_4)
group_10 = Group(Objects=qrmesh_3)
group_11 = Group(Objects=flatten([group_9, group]))
move2pt_11 = MoveToPoint(Geometry=qrmesh_4, PointA=pt_11, PointB=graft(pt_12))  # -> flatten(Moved), Vector, Transform
move2pt_12 = MoveToPoint(Geometry=move2pt_10.Moved, PointA=pt_11, PointB=pt_12)  # -> flatten(Moved), Vector, Transform
move2pt_13 = MoveToPoint(Geometry=qrmesh_3, PointA=pt_11, PointB=pt_12)  # -> flatten(Moved), Vector, Transform
merge_8 = Merge(Data1=move2pt_12.Moved, Data2=move2pt_11.Moved)

number_slider_7 = Slider(1.5, range=1..2)
range_7 = Range(Domain=Slider(3.7, range=0..6.002), Steps=number_slider_7)
range_8 = Range(Domain=Domain(0, 1), Steps=number_slider_7)
graph_5 = GraphMapper(range_8, x0=0, x1=1, y0=0, y1=1, container_name="Bezier", cpx=[0, 0.5185281634, 1, 1], cpy=[0, 0, 0.1436586976, 1])
pt_13 = ConstructPoint(XCoordinate=0, YCoordinate=0, ZCoordinate=range_7)
dom_5 = ConstructDomain(DomainStart=Slider(4.2, range=1..13), DomainEnd=Slider(1.2, range=0..2.02))
bnd_6 = Bounds(Numbers=graph_5)
prot_3 = RotatePlane(Plane=pt_13, Angle="0.5*pi")
remap_5 = RemapNumbers(Value=graph_5, Source=bnd_6, Target=dom_5)  # -> Mapped, Clipped
cir_3 = Circle(Plane=prot_3, Radius=remap_5.Mapped)
item_20 = ListItem(List=cir_3, Index=0, Wrap=True)
area_5 = Area(Geometry=item_20)  # -> Area, Centroid
number_slider_8 = Slider(0.01, range=0..1)
range_9 = Range(Domain=Domain(0, 1), Steps=Slider(8, range=0..50))
shatter_3 = Shatter(Curve=reparameterize(graft(cir_3)), Parameters=range_9)
subtraction_4 = Subtraction(A="1", B=number_slider_8)
merge_9 = Merge(Data1="0", Data2=number_slider_8, Data3=subtraction_4, Data4="1")
consec_3 = ConsecutiveDomains(Numbers=merge_9, Additive=invert(True))
panel_30 = Panel(merge_9)
subcrv_3 = SubCurve(BaseCurve=reparameterize(graft(shatter_3)), Domain=consec_3)
panel_31 = Panel("""0
2""")
panel_32 = Panel(consec_3)
cull_i_4 = CullIndex(List=subcrv_3, Indices=panel_31, Wrap=True)  # -> simplify(List)
item_21 = ListItem(List=subcrv_3, Index=panel_31, Wrap=True)
pshift_5 = ShiftPaths(Data=cull_i_4, Offset=-1)
flip_5 = FlipMatrix(Data=pshift_5)
midpt_3 = CurveMiddle(Curve=flip_5)
loft_7 = Loft(Curves=cir_3, Options={Adjust=False, Closed=False, LoftEnds=0, LoftSimp=0, LoftType=0, Rebuild=10, Refit=0.01})
pshift_6 = ShiftPaths(Data=item_21, Offset=-1)
graph_6 = GraphMapper(range_8, x0=0, x1=1, y0=0, y1=1, container_name="Bezier", cpx=[0, 0.25, 0.75, 1], cpy=[0, 0.25, 0.75, 1])
join_6 = JoinCurves(Curves=pshift_6, Preserve=False)
brep_cp_3 = BrepClosestPoint(Point=midpt_3, Brep=loft_7)  # -> Point, Normal, Distance
dom_6 = ConstructDomain(DomainStart=Slider(0.1, range=0..10), DomainEnd=Slider(0.11, range=0..1))
flip_6 = FlipMatrix(Data=join_6)
bnd_7 = Bounds(Numbers=graph_6)
remap_6 = RemapNumbers(Value=graph_6, Source=bnd_7, Target=dom_6)  # -> Mapped, Clipped
amp_3 = Amplitude(Vector=brep_cp_3.Normal, Amplitude=remap_6.Mapped)
rev_3 = Reverse(Vector=amp_3)
end_5 = EndPoints(Curve=flip_5)  # -> Start, End
move_5 = Move(Geometry=midpt_3, Motion=rev_3)  # -> Geometry, Transform
arc_3 = Arc3Pt(PointA=end_5.Start, PointB=move_5.Geometry, PointC=end_5.End)  # -> Arc, Plane, Radius
item_22 = ListItem(List=arc_3.Arc, Index=0, Wrap=True)
project_4 = Project(Geometry=item_22, Plane=PlaneXY(0, 0, 0))  # -> Geometry, Transform
loft_opt_3 = LoftOptions(Closed=False, Adjust=False, Rebuild=0, Refit="0.01", Type=0)
replace_3 = ReplaceItems(List=arc_3.Arc, Item=project_4.Geometry, Indices="0", Wrap=False)
loft_8 = Loft(Curves=flip_6, Options=loft_opt_3)
loft_9 = Loft(Curves=replace_3, Options=loft_opt_3)
entwine_8 = Entwine(Branch00=loft_9, Branch01=loft_8, FlattenInputs=True)
merge_10 = Merge(Data1=ColourSwatch(SwatchColor=RGBA(107, 107, 107, 206)), Data2=ColourSwatch(SwatchColor=RGB(255, 255, 255)))  # -> simplify(graft(Result))
python_3 = GhPythonScript(S=entwine_8, D=Slider(0.01, range=0..1))  # -> simplify(a); inputs S: Brep; same code as python
brep_8 = Brep(cap)
flatten_3 = FlattenTree(Tree=python_3, Path="{0}")

Z_5 = UnitZ(Factor=expr("-x", Slider(0.1, range=0..10)))
item_23 = ListItem(List=cir_3, Index="-1", Wrap=True)
extr_4 = Extrude(Base=item_23, Direction=Z_5)
cap_5 = CapHoles(Brep=extr_4)

item_24 = ListItem(List=flatten(brep_8), Index=0, Wrap=True)

volume_7 = Volume(Geometry=item_24)  # -> Volume, Centroid
move2pt_14 = MoveToPoint(Geometry=flatten_3, PointA=area_5.Centroid, PointB=graft(volume_7.Centroid))  # -> simplify(Moved), Vector, Transform
lng_3 = ListLength(List=move2pt_14.Moved)
graft_3 = GraftTree(Tree=volume_7.Centroid, IncludeEmptyLists=True, IncludeNullItems=True)  # -> simplify(Tree)
group_12 = Group(Objects=move2pt_14.Moved)
split_6 = SplitList(List=move2pt_14.Moved, Index=expr("x/2", lng_3))  # -> flatten(ListA), flatten(ListB)
mirror_3 = Mirror(Geometry=group_12, Plane=graft_3)  # -> Geometry, Transform
ungroup_3 = Ungroup(Group=mirror_3.Geometry)
move2pt_15 = MoveToPoint(Geometry=cap_5, PointA=area_5.Centroid, PointB=graft(volume_7.Centroid))  # -> Moved, Vector, Transform
entwine_9 = Entwine(Branch00=split_6.ListA, Branch01=split_6.ListB, FlattenInputs=True)  # -> simplify(Result)
split_7 = SplitList(List=ungroup_3, Index=expr("x/2", lng_3))  # -> flatten(ListA), flatten(ListB)
entwine_10 = Entwine(Branch00=split_7.ListA, Branch01=split_7.ListB, FlattenInputs=True)  # -> simplify(Result)
merge_11 = Merge(Data1=entwine_9, Data2=entwine_10)

volume_8 = Volume(Geometry=brep_8)  # -> Volume, Centroid
data_5 = Data([split_6.ListB, split_7.ListB])
data_6 = Data([split_6.ListA, split_7.ListA])
qrmesh_5 = QuadRemesh(Mesh=data_6, Settings={aqc=True, as=50, dhe=True, gci=0, null=False, pme=0, sa=0, tqc=2000})  # -> graft(QuadResult)
qrmesh_6 = QuadRemesh(Mesh=data_5, Settings={aqc=True, as=50, dhe=True, gci=0, null=False, pme=0, sa=0, tqc=2000})

# ---- group: units centroids
pt_14 = Point(flatten(volume_8.Centroid))

# ---- group: unit centroid
pt_15 = Point(volume_7.Centroid)

# ----
group_13 = Group(Objects=qrmesh_6)
group_14 = Group(Objects=qrmesh_5)
group_15 = Group(Objects=flatten([group_13, group_3]))
move2pt_16 = MoveToPoint(Geometry=qrmesh_6, PointA=pt_15, PointB=graft(pt_14))  # -> flatten(Moved), Vector, Transform
move2pt_17 = MoveToPoint(Geometry=qrmesh_5, PointA=pt_15, PointB=pt_14)  # -> flatten(Moved), Vector, Transform
move2pt_18 = MoveToPoint(Geometry=[move2pt_15.Moved, qrmesh_6], PointA=pt_15, PointB=pt_14)  # -> flatten(Moved), Vector, Transform
merge_12 = Merge(Data1=move2pt_16.Moved, Data2=move2pt_18.Moved)

filter_6 = StreamFilter(Gate=list_2, Stream1=[move2pt_17.Moved, move2pt_13.Moved, move2pt_8.Moved])
name_7 = ExtendSpeckleObject(
    SpeckleObject=filter_6,
    BIMSCPROJECT=bimsc_project,
    BIMSCORIGINATOR=bimsc_originator,
    BIMSCVOLUME=bimsc_volume,
    BIMSCLEVEL=floor_levels_6,
    BIMSCTYPE="UNITS INFLATABLE",
    BIMSCMATERIAL="Inflatable",
    RenderMaterial=dso.Insulation,
    BIMSCPHASE=num_5,
    selectedKitName="Objects")  # -> flatten(ExtendedSpeckleObject)

# ----
# UNITS
filter_7 = StreamFilter(Gate=list_2, Stream1=[merge_12, merge_8, merge_4])
name_8 = ExtendSpeckleObject(
    SpeckleObject=filter_7,
    BIMSCPROJECT=bimsc_project,
    BIMSCORIGINATOR=bimsc_originator,
    BIMSCVOLUME=bimsc_volume,
    BIMSCLEVEL=floor_levels_5,
    BIMSCTYPE="UNIT STRUCTURE",
    BIMSCMATERIAL="Steel",
    RenderMaterial=dso.Steel,
    BIMSCPHASE=num,
    selectedKitName="Objects")  # -> flatten(ExtendedSpeckleObject)

# ----
# 01 //Create Revit materials from Rhino M Properties
cset_3 = CreateSet(List=flatten(ef_layer_2))  # -> Set, Map; disabled
material = AddMaterial(Name=cset_3.Set, TrackingMode=2)  # disabled

# ---- group: MaterialProperties
python_4 = GhPythonScript(Mname=cset_3.Set)  # -> out, Pvalue, Pname; disabled
# ---------- python_4: Python ----------
__author__ = "hesham.shawqy"
__version__ = "2024.02.25"

import rhinoscriptsyntax as rs
import Rhino.DocObjects as rd
import Rhino as rh

def get_material_properties(Mname):
    # Get the active Rhino document
    doc = rh.RhinoDoc.ActiveDoc
    
    # Search for the material by name
    material_index = doc.Materials.Find(Mname, True)
    if material_index < 0:
        print("Material not found.")
        return None
    
    # Retrieve the material object
    material = doc.Materials[material_index]
    
    # Extract material properties
    properties = {
        "DiffuseColor": material.DiffuseColor,
        "Transparency": material.Transparency,
        # Add more properties as needed
    }
    
    return properties

Pname = []
Pvalue = []
material_properties = get_material_properties(Mname)
if material_properties:
    for prop, value in material_properties.items():
        Pvalue.append(value)
        Pname.append(prop)
# ---------- end python_4 ----------

# ----
item_25 = ListItem(List=python_4.Pvalue, Index=0, Wrap=True)  # -> Item, Item1; disabled
graphics = MaterialGraphics(
    Material=graft(material),
    Color=item_25.Item,
    Transparency=item_25.Item1,
    ForegroundPatternCutPatterns=<geometry referenced from the Revit model>)  # -> Material, UseRenderAppearance, Color, Transparency, SurfacePatternsForegroundPattern, SurfacePatternsForegroundColor, CutPatternsForegroundPattern, CutPatternsForegroundColor; disabled

# ----
# SEND TO SPLECKLE STREAMS
# G6_STUDIO_MAIN_MODEL
# https://macad.speckle.xyz/streams/677b44128b
# G06_test_Unreal
# https://macad.speckle.xyz/streams/5e4e4e4563
# g06 wip branch
# https://macad.speckle.xyz/streams/4975f9f0a8/branches/wip%2Fg06
# g06 shared branch
# https://macad.speckle.xyz/streams/4975f9f0a8/branches/shared%2Fg06
panel_33 = Panel("G06_AssembledModel_V4")
cso = CreateSpeckleObject(
    ROOF=name_4,
    WALL=name_5,
    FLOORS=name_2,
    PODS=name_3,
    UNITSINFLATABLES=name_7,
    UNITSTRUCTURE=name_8,
    TERRAIN=name,
    SITE_A4=name_6,
    selectedKitName="Objects")

# ----
# Always Leave Send Component Unplugged
# in the stream input before closing and
# saving this gh file
send = Send(
    Message=panel_33,
    D=cso,
    AutoSend=False,
    BaseId="81f03236b71b13f63b781442c5bde320",
    CurrentComponentState="up_to_date",
    KitName="Objects",
    OutputWrappers="https://macad.speckle.xyz\t677b44128b\tcb70638a05",
    UseDefaultCache=True,
    selectedKitName="Objects")

rec = DataRecorder(send, DataLimit=-10, RecordData=True)
panel_34 = Panel(rec)
